# Dynamo graph ssMgr.dyn (Dynamo 2.5.2.7915)

code_block = CodeBlock { "E:\\Programming\\Testing2.dst"; false; }
openDatabase = AMR.dynSSetMgr.SheetSetMgr.OpenDatabase(filename=code_block.out0, bFailIfAlreadyOpen=code_block.out1)
code_block_2 = CodeBlock { "E:\\Programming\\Testing5.dst"; ""; true; }
setFileName = AMR.dynSSetMgr.Database.SetFileName(amrDatabase=openDatabase, filename=code_block_2.out0)
getFileName = AMR.dynSSetMgr.Database.GetFileName(amrDatabase=setFileName)
getSheetSet = AMR.dynSSetMgr.Database.GetSheetSet(amrDatabase=openDatabase)
getName = AMR.dynSSetMgr.SheetSet.GetName(sheetSet=getSheetSet)
