# Dynamo graph test 2.dyn (Dynamo 2.5.2.7915)

code_block = CodeBlock { "C:\\Users\\areilly\\Documents\\AutoCAD Sheet Sets\\Testing 2.dst"; }
openDatabase = AMR.dynSSetMgr.SheetSetMgr.OpenDatabase(filename=code_block)
getDatabases = AMR.dynSSetMgr.SheetSetMgr.GetDatabases()
getDescription = AMR.dynSSetMgr.Database.GetDescription(database=getDatabases)
getName = AMR.dynSSetMgr.Database.GetName(database=getDatabases)
getSheetSet = AMR.dynSSetMgr.Database.GetSheetSet(database=getDatabases)
getName_2 = AMR.dynSSetMgr.SheetSet.GetName(sheetSet=getSheetSet)
getDesc = AMR.dynSSetMgr.SheetSet.GetDesc(sheetSet=getSheetSet)
